# Grasshopper definition Coordinates.gh (Grasshopper 1.0.7)
# Copyright: Arup

pt = Point([Point(42106.3537, 83189.9603, -1350), Point(42064.965, 83417.8922, -1350), Point(42064.965, 83417.8922, 1000), Point(41836.2774, 84677.298, 1000), Point(41836.2774, 84677.298, -1350), Point(41079.0479, 88847.4378, -1350), Point(41079.0479, 88847.4378, 2850), Point(42106.3537, 83189.9603, 2850)])
crv = Curve(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)
crv_2 = Curve(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)

crv_3 = Curve(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)
crv_4 = Curve(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)
crv_5 = Curve(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)

crv_6 = Curve(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)
crv_7 = Curve(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)
crv_8 = Curve(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)

crv_9 = Curve(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)
crv_10 = Curve(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)
crv_11 = Curve(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)
crv_12 = Curve(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)
crv_13 = Curve(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)
crv_14 = Curve(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)
crv_15 = Curve(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)
pt_2 = Point([Point(41079.0479, 88847.4378, 2850), Point(45177.0349, 89591.5655, 2850), Point(45177.0349, 89591.5655, 5200), Point(46485.6358, 89829.1862, 5200), Point(46485.6358, 89829.1862, 2850), Point(46756.1572, 89878.3084, 2850), Point(46756.1572, 89878.3084, 7450), Point(41079.0479, 88847.4378, 7450)])
crv_16 = Curve(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)
panel = Panel("0")
curvetopts = CurveToPts(C=crv_16)
curvetopts_2 = CurveToPts(C=crv_4)
curvetopts_3 = CurveToPts(C=crv_5)
curvetopts_4 = CurveToPts(C=crv_3)
tester = CSharpScript(
    Points=pt_2,
    Reference=["C:\NICOLAAS\REPO\SPECKLESTRUCTURAL\SPECKLESTRUCTURALCLASSES\BIN\DEBUG\MathNet.Numerics.dll", "C:\NICOLAAS\REPO\SPECKLESTRUCTURAL\SPECKLESTRUCTURALCLASSES\BIN\DEBUG\MathNet.Spatial.dll", "C:\Nicolaas\Repo\SpeckleStructural\SpeckleStructuralClasses\bin\Debug\SpeckleStructuralClasses.dll"])  # -> out, InternalLines; inputs Points: list of Point3d, Opening1Pts: list of Point3d, Opening2Pts: list of Point3d
# ---------- tester: C# ----------
    Print("Test");
    var ma = new SpeckleStructuralClasses.PolygonMesher.PolygonMesher();


    var openingPointsList = new List<double[]>();
    if (Opening1Pts != null && Opening1Pts.Count > 0)
    {
      openingPointsList.Add(PointsToCoords(Opening1Pts));
    }
    if (Opening2Pts != null && Opening2Pts.Count > 0)
    {
      openingPointsList.Add(PointsToCoords(Opening2Pts));
    }

    ma.Init(PointsToCoords(Points), openingPointsList);

    var internalGlobalCoords = ma.GetInternalGlobalCoords();

    Print("Check");
    var lines = new List<Rhino.Geometry.Line>();
    foreach (var coords in internalGlobalCoords)
    {
      var pt1 = new Rhino.Geometry.Point3d(coords[0], coords[1], coords[2]);
      var pt2 = new Rhino.Geometry.Point3d(coords[3], coords[4], coords[5]);
      lines.Add(new Rhino.Geometry.Line(pt1, pt2));
    }

    InternalLines = lines;
    //var faces = ma.Faces();
# ---------- tester: C# additional code ----------
  private double[] PointsToCoords(List<Point3d> Points)
  {
    var vs = new List<double>();
    foreach (Point3d p in Points)
    {
      vs.Add(p.X);
      vs.Add(p.Y);
      vs.Add(p.Z);
    }
    return vs.ToArray();
  }
# ---------- end tester ----------

pt_3 = Point([curvetopts_2, curvetopts_3, curvetopts_4])
subtraction = Subtraction(A=Slider(12, range=1..12), B="1")
panel_2 = Panel(subtraction)
item = ListItem(List=pt_3, Index=subtraction, Wrap=True)
pt_4 = Point(item)

curvetopts_5 = CurveToPts()
curvetopts_6 = CurveToPts(C=crv_8)

pt_5 = Point(curvetopts_6)
subtraction_2 = Subtraction(A=Slider(2, range=1..12), B="1")
panel_3 = Panel(subtraction_2)
item_2 = ListItem(List=pt_5, Index=subtraction_2, Wrap=True)
pt_6 = Point(item_2)

curvetopts_7 = CurveToPts()
line = Line(tester.InternalLines)
panel_4 = Panel(curvetopts_5)
tester_2 = CSharpScript(
    Points=curvetopts_6,
    Opening1Pts=curvetopts_7,
    Opening2Pts=curvetopts_5,
    Reference=["C:\Nicolaas\Repo\SpeckleStructural\SpeckleStructuralClasses\bin\Debug\MathNet.Numerics.dll", "C:\Nicolaas\Repo\SpeckleStructural\SpeckleStructuralClasses\bin\Debug\MathNet.Spatial.dll", "C:\Nicolaas\Repo\SpeckleStructural\SpeckleStructuralClasses\bin\Debug\SpeckleStructuralClasses.dll"])  # -> out, InternalLines; inputs Points: list of Point3d, Opening1Pts: list of Point3d, Opening2Pts: list of Point3d
# ---------- tester_2: C# usings ----------
using SpeckleStructuralClasses;
# ---------- tester_2: C# ----------
    Print("Test");
    var ma = new SpeckleStructuralClasses.PolygonMesher.PolygonMesher();

    var openingPointsList = new List<double[]>();
    if (Opening1Pts != null && Opening1Pts.Count > 0)
    {
      openingPointsList.Add(PointsToCoords(Opening1Pts));
    }
    if (Opening2Pts != null && Opening2Pts.Count > 0)
    {
      openingPointsList.Add(PointsToCoords(Opening2Pts));
    }

    ma.Init(PointsToCoords(Points), openingPointsList);

    var internalGlobalCoords = ma.GetInternalGlobalCoords();

    Print("Check");
    var lines = new List<Rhino.Geometry.Line>();
    foreach (var coords in internalGlobalCoords)
    {
      var pt1 = new Rhino.Geometry.Point3d(coords[0], coords[1], coords[2]);
      var pt2 = new Rhino.Geometry.Point3d(coords[3], coords[4], coords[5]);
      lines.Add(new Rhino.Geometry.Line(pt1, pt2));
    }

    InternalLines = lines;
    //var faces = ma.Faces();
# ---------- tester_2: C# additional code ----------
  private double[] PointsToCoords(List<Point3d> Points)
  {
    var vs = new List<double>();
    foreach (Point3d p in Points)
    {
      vs.Add(p.X);
      vs.Add(p.Y);
      vs.Add(p.Z);
    }
    return vs.ToArray();
  }
# ---------- end tester_2 ----------
line_2 = Line(tester_2.InternalLines)
panel_5 = Panel(tester_2.out)

# ==== cluster CurveToPts
C = ClusterInput()
explode = Explode(Curve=C, Recursive=True)  # -> Segments, Vertices
cullduppoints = RemoveDuplicatePoints(InputPoints=explode.Vertices, Tolerance=0.001)  # -> OutputPoints, FirstPointIndexes
clean = CleanTree(RemoveNulls=True, RemoveInvalid=True, RemoveEmpty=False, Tree=cullduppoints.OutputPoints)
pt = Point(clean)
pt_2 = ClusterOutput(pt)
