# Grasshopper definition PointsExample.gh (Grasshopper 1.0.7)
# Copyright: Arup

panel = Panel("""41079.0479
88847.4378
2850
45177.0349
89591.5655
2850
45177.0349
89591.5655
5200
46485.6358
89829.1862
5200
46485.6358
89829.1862
2850
46756.1572
89878.3084
2850
46756.1572
89878.3084
7450
41079.0479
88847.4378
7450""")
panel_2 = Panel("""0
3
6
9
12
15
18
21""")
addition = Addition(A=panel_2, B="2")
dom = ConstructDomain(DomainStart=panel_2, DomainEnd=addition)
subset = SubList(List=panel, Domain=dom, Wrap=True)  # -> List, Index
item = ListItem(List=subset.List, Index=0, Wrap=True)  # -> Item, Item1, Item2
pt = ConstructPoint(XCoordinate=item.Item, YCoordinate=item.Item1, ZCoordinate=item.Item2)  # -> flatten(Point)
item_2 = ListItem(List=pt, Index=Slider(1, range=1..8), Wrap=True)
pt_2 = Point(pt)
pt_3 = Point([Point(41079.0479, 88847.4378, 2850), Point(45177.0349, 89591.5655, 2850), Point(45177.0349, 89591.5655, 5200), Point(46485.6358, 89829.1862, 5200), Point(46485.6358, 89829.1862, 2850), Point(46756.1572, 89878.3084, 2850), Point(46756.1572, 89878.3084, 7450), Point(41079.0479, 88847.4378, 7450)])
