# Grasshopper definition AssemblyWithDistances.gh (Grasshopper 1.0.7)
# Copyright: Arup
# plug-ins: UserDataUtils

panel = Panel("0.2")
sbc = SchemaBuilderComponent(
    YoungsModulus="28000000000",
    ShearModulus="11666700000",
    Density="2400",
    CoeffThermalExpansion="0.00001",
    CompressiveStrength="40000000",
    MaxStrain="0.003",
    AggragateSize="0.02",
    ApplicationId="concrete",
    Name="Concrete",
    assembly="SpeckleStructuralClasses.StructuralMaterialConcrete, SpeckleStructuralClasses, Version=1.0.0.0, Culture=neutral, PublicKeyToken=null",
    init=True,
    type="StructuralMaterialConcrete")

pt = Point(Point(-7, 89, 0))
mesh = Mesh(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)
line = Line(Line((10, -12, 0), (10, 6, 0)))
line_2 = Line(Line((-13, -11, 0), (-13, 12, 0)))

sbc_2 = SchemaBuilderComponent(
    Thickness="300",
    MaterialRef="concrete",
    ReferenceSurface="Middle",
    ApplicationId="sp",
    Name="Slab property",
    assembly="SpeckleStructuralClasses.Structural2DProperty, SpeckleStructuralClasses, Version=1.0.0.0, Culture=neutral, PublicKeyToken=null",
    init=True,
    type="Structural2DProperty")

scale = Scale(Geometry=mesh, Center=Point(0, 0, 0), Factor="1000")  # -> Geometry, Transform
scale_2 = Scale(Geometry=line, Center=Point(0, 0, 0), Factor="1000")  # -> Geometry, Transform
scale_3 = Scale(Geometry=line_2, Center=Point(0, 0, 0), Factor="1000")  # -> Geometry, Transform
panel_2 = Panel("""2000
3000
4000
5000""")
sbc_3 = SchemaBuilderComponent(
    BaseMesh=scale.Geometry,
    ElementType="Slab",
    PropertyRef="sp",
    ApplicationId="Test2DMember",
    Name="Test Mesh",
    assembly="SpeckleStructuralClasses.Structural2DElementMesh, SpeckleStructuralClasses, Version=1.0.0.0, Culture=neutral, PublicKeyToken=null",
    init=True,
    type="Structural2DElementMesh")
num = Number(panel_2)
sbc_4 = SchemaBuilderComponent(
    NumPoints="5",
    BaseLine=scale_3.Geometry,
    OrientationPoint=pt,
    Width="100",
    ElementRefs="Test2DMember",
    Name="With NumPoints",
    assembly="SpeckleStructuralClasses.StructuralAssembly, SpeckleStructuralClasses, Version=1.0.0.0, Culture=neutral, PublicKeyToken=null",
    init=True,
    type="StructuralAssembly")
sbc_5 = SchemaBuilderComponent(
    PointDistances=num,
    BaseLine=scale_2.Geometry,
    OrientationPoint=pt,
    Width="100",
    ElementRefs="Test2DMember",
    Name="With PointDistances",
    assembly="SpeckleStructuralClasses.StructuralAssembly, SpeckleStructuralClasses, Version=1.0.0.0, Culture=neutral, PublicKeyToken=null",
    init=True,
    type="StructuralAssembly")
anonymous_stream = DataSender(A=sbc_4, B=sbc_5, C=sbc_3, D=sbc_2, E=sbc, DebouncingDisabled=False, manualmode=False, remotecontroller=False)  # -> Log, StreamId
